# Grasshopper definition Custom class generation via CustomObject.gh (Grasshopper 0.9.76)
# plug-ins: BH.UI.Grasshopper

# Custom class generation via CustomObject
panel = Panel("SomeCustomType")
pop2d = Populate2D(Region={Plane=PlaneXY(0, 0, 0), Size=Domain2(u=0..20, v=0..10)}, Count=Slider(3, range=0..10), Seed=1)
series = Series(Start=0, Step=1, Count=10)
localrepositorysettings = LocalRepositorySettings(
    GitRootPath="C:\Users\alombardi\GitHub",
    CacheRootPath="C:\ProgramData",
    CacheFileName_RepositoryAllFilePaths="cached_RepositoryAllFilePaths.txt",
    CacheFileName_PropertyInfoFileLines="cached_PropertyInfoFileLines.txt",
    GithubOrganisationURL="https://github.com/BHoM/",
    ReadCacheFiles=True,
    WriteCacheFiles=False,
    Component="BH.oM.RDF.LocalRepositorySettings")
createcustom = CreateCustom(Type=panel, listOfNumbers=series, listOfPoints=pop2d, Component="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")
ontologysettings = OntologySettings(
    OntologyTitle="220627-081902_newBHoMOntology",
    OntologyDescription="New BHoM ontology",
    OntologyBaseAddress="http://visualdataweb.org/",
    TBoxSettings="{ \"_t\" : \"BH.oM.RDF.TBoxSettings\", \"CustomObjectTypesBaseAddress\" : \"http://customizeMeFrom-OntologySettings.TBoxSettings.CustomObjectTypesBaseAddress\", \"TreatCustomObjectsWithTypeKeyAsCustomObjectTypes\" : true, \"CustomobjectsTypeKey\" : \"Type\", \"_bhomVersion\" : \"5.2\" }",
    ABoxSettings="{ \"_t\" : \"BH.oM.RDF.ABoxSettings\", \"IndividualsBaseAddress\" : \"http://customizeMeFrom-OntologySettings.ABoxSettings.IndividualsBaseAddress\", \"ConsiderDefaultPropertyValues\" : true, \"ConsiderNullOrEmptyPropertyValues\" : false, \"_bhomVersion\" : \"5.2\" }",
    Component="BH.oM.RDF.OntologySettings")
ttlgraph = TTLGraph(
    IObjects=createcustom,
    OntologySettings=ontologysettings,
    LocalRepositorySettings=localrepositorysettings,
    Component="{ .TTLGraph")
panel_2 = Panel(ttlgraph)
