# Grasshopper definition ReadTTL.gh (Grasshopper 0.9.76)
# plug-ins: BH.UI.Grasshopper

# Read from TTL
# Create an object, convert it to TTL,
# then read the TTL text and convert it
# back to the original object.
crv = Curve(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)
room = Room(Perimeter=crv, Name="Test room", Component="BH.oM.Architecture.Elements.Room")
localrepositorysettings = LocalRepositorySettings(
    RepositoryRootPath="C:\Users\alombardi\GitHub",
    CacheRootPath="C:\ProgramData",
    CacheFileName_RepositoryAllFilePaths="cached_RepositoryAllFilePaths.txt",
    CacheFileName_PropertyInfoFileLines="cached_PropertyInfoFileLines.txt",
    GithubOrganisationURL="https://github.com/BHoM/",
    ReadCacheFiles=True,
    WriteCacheFiles=False,
    Component="BH.oM.RDF.LocalRepositorySettings")
ontologysettings = OntologySettings(
    OntologyTitle="220625-184813_newBHoMOntology",
    OntologyDescription="New BHoM ontology",
    OntologyBaseAddress="http://visualdataweb.org/",
    TBoxSettings="{ \"_t\" : \"BH.oM.RDF.TBoxSettings\", \"CustomObjectTypesBaseAddress\" : \"http://customizeMeFrom-OntologySettings.TBoxSettings.CustomObjectTypesBaseAddress\", \"TreatCustomObjectsWithTypeKeyAsCustomObjectTypes\" : true, \"CustomobjectsTypeKey\" : \"Type\", \"_bhomVersion\" : \"5.2\" }",
    ABoxSettings="{ \"_t\" : \"BH.oM.RDF.ABoxSettings\", \"IndividualsBaseAddress\" : \"http://customizeMeFrom-OntologySettings.ABoxSettings.IndividualsBaseAddress\", \"ConsiderDefaultPropertyValues\" : true, \"ConsiderNullOrEmptyPropertyValues\" : false, \"_bhomVersion\" : \"5.2\" }",
    Component="BH.oM.RDF.OntologySettings")
ttlgraph = TTLGraph(
    IObjects=room,
    OntologySettings=ontologysettings,
    LocalRepositorySettings=localrepositorysettings,
    Component="{ .TTLGraph")
panel = Panel(ttlgraph)
readttl = ReadTTL(TTLtext=ttlgraph, Component="{ .ReadTTL")
panel_2 = Panel(readttl)
