# Grasshopper definition toTTLcSharpComponentClass.gh (Grasshopper 1.0.7)

c_script = CSharpScript(Reference=["C:\ProgramData\BHoM\Assemblies\BHoM_Engine.dll", "C:\ProgramData\BHoM\Assemblies\BHoM.dll", "C:\ProgramData\BHoM\Assemblies\RDF_Engine.dll", "C:\ProgramData\BHoM\Assemblies\RDF_oM.dll"])  # -> out, A
# ---------- c_script: C# usings ----------
using BH.Engine.RDF;
using BH.oM.RDF;
# ---------- c_script: C# ----------
    Tester t = new Tester();
    t.Name = "MyName";
    t.Index = 34;
    t.Number = 1.55;

    A = Compute.TTLGraph(new List<Object>() {t}, new OntologySettings());
# ---------- c_script: C# additional code ----------
  class Tester
  {
    private string name; // field
    private int index;
    private double number;

    public string Name   // property
    {
      get { return name; }   // get method
      set { name = value; }  // set method
    }

    public int Index   // property
    {
      get { return index; }   // get method
      set { index = value; }  // set method
    }

    public double Number   // property
    {
      get { return number; }   // get method
      set { number = value; }  // set method
    }

    public Tester()
    {
    }

  }
# ---------- end c_script ----------
panel = Panel(c_script.A)
