# Grasshopper definition #51 - Push to GraphDB.gh (Grasshopper 1.0.7)
# plug-ins: BH.UI.Grasshopper, sof_gh_sofistik-2022

io = IO(
    SofistikDocumentProperties_VersionMajor="2022",
    SofistikDocumentProperties_VersionMinor="4",
    SofistikDocumentProperties_VersionName="2022")

aboxsettings = ABoxSettings(
    IndividualsBaseAddress="www.uni-stuttgart.de",
    ConsiderDefaultPropertyValues=True,
    ConsiderNullOrEmptyPropertyValues=False,
    Component="BH.oM.RDF.ABoxSettings")

tboxsettings = TBoxSettings(
    CustomObjectTypesBaseAddress="http://customizeMeFrom-OntologySettings.TBoxSettings.CustomObjectTypesBaseAddress",
    TypeUris=null,
    DefaultBaseUriForUnknownTypes="http://customizeFrom-OntologySettings.TBoxSettings.DefaultBaseUriForUnknownTypes",
    TreatCustomObjectsWithTypeKeyAsCustomObjectTypes=True,
    CustomobjectsTypeKey="Type",
    Component="BH.oM.RDF.TBoxSettings")
localrepositorysettings = LocalRepositorySettings(
    GitRootPath="C:\Users\Aaron\Documents\GitHub\BHoM",
    CacheRootPath="C:\ProgramData",
    CacheFileName_RepositoryAllFilePaths="cached_RepositoryAllFilePaths.txt",
    CacheFileName_PropertyInfoFileLines="cached_PropertyInfoFileLines.txt",
    ReadCacheFiles=True,
    WriteCacheFiles=False,
    Component="BH.oM.RDF.LocalRepositorySettings")
ontologysettings = OntologySettings(
    OntologyTitle=" bhom ontology",
    OntologyDescription="buidling ontology",
    OntologyBaseAddress="http://www.bhom.org",
    TBoxSettings=tboxsettings,
    ABoxSettings=aboxsettings,
    Component="BH.oM.RDF.OntologySettings")

curve = Curve(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)
curve_2 = Curve(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)
curve_3 = Curve(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)
room = Room(Perimeter=curve_3, Name="MyRoom", Component="BH.oM.Architecture.Elements.Room")
column = Column(Location=curve_2, Name="MyColumn", Component="BH.oM.Physical.Elements.Column")
column_2 = Column(Location=curve, Name="MyColumn", Component="BH.oM.Physical.Elements.Column")
createcustom = CreateCustom(
    Type="Building",
    hasColumn=flatten([column, column_2]),
    hasRoom=room,
    Component="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")

# ----
# .TTL File Directory
panel = Panel("G:\My Drive\03_Arbeit\02_HIWI Stellen\03_Architectural_Computing\TTL Files\BhomOuput.ttl")

# ----
# Post RDF Data to GraphDB
panel_2 = Panel("C:\Users\Aaron\AppData\Local\GraphDB Desktop\GraphDB Desktop.exe")
graphdbprocess = GraphDBProcess(GraphDBfilePath=panel_2, Run=Toggle(False), Component="{ .GraphDBProcess")
posttorepo = PostToRepo(
    FilePathRDFData=panel,
    ServerAddress="http://localhost:7200/",
    RepositoryName="BHoMVisualization",
    DeleteRepository=Toggle(False),
    Run=Toggle(False),
    Component="{ .PostToRepo")

ttlgraph = TTLGraph(
    Objects=createcustom,
    OntologySettings=ontologysettings,
    LocalRepositorySettings=localrepositorysettings,
    Component="{ .TTLGraph")
# RDF .TTL Export
ttlgraph_2 = TTLGraph(
    Objects=createcustom,
    FilePath=panel,
    OntologySettings=ontologysettings,
    LocalRepositorySettings=localrepositorysettings,
    Component="{ .TTLGraph")
readttl = ReadTTL(TTLtext=ttlgraph, Component="{ .ReadTTL")
explode = Explode(Object=readttl, Component="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")  # -> Type, HasColumn, HasRoom, Name, Tags, BHoM_Guid
